# Grasshopper definition ExcelDynamicReadBMWBackUp.gh (Grasshopper 1.0.7)
# plug-ins: ExcelReadWrite

# ---- group: Number of a sheet
slider = Slider(4, range=1..4)

# ---- group: Put here columns you need
panel = Panel("C2:C40")
panel_2 = Panel("A2:A40")

# ---- group: Press to load!
toggle = BooleanToggle(True)

# ---- group: Set EXCEL file here
path = FilePath("\\oecc-databox\Projekte\18005_BAM18_BMW_Portal-West_AFM\12_Flaechen\00_Liste_Flächen_Aktuell.xlsx")

# ----
merge = Merge(Data1=panel_2, Data2=panel, Data3="c2:c26")
exdread = ExcelDynamicRead(ExcelFile=path, Connect=toggle, SheetNum=slider, DataRange=merge)  # -> DataOutput, Message
panel_3 = Panel(exdread.DataOutput)

# ---- group: Geschoss
panel_4 = Panel(exdread.DataOutput)
tree_branch = TreeBranch(Tree=panel_4, Path=Slider(0, range=0..1), MaintainPaths=True)
panel_5 = Panel(tree_branch)

# ---- group: Fläche
panel_6 = Panel(exdread.DataOutput)
tree_branch_2 = TreeBranch(Tree=panel_6, Path=Slider(1, range=0..1), MaintainPaths=True)
panel_7 = Panel(tree_branch_2)

# ---- group: Group branches (Columns)
panel_8 = Panel(exdread.DataOutput)
tree_branch_3 = TreeBranch(Tree=panel_8, Path=Slider(2, range=0..3), MaintainPaths=True)
panel_9 = Panel(tree_branch_3)

# ----
ghpython_script = GhPythonScript(X=tree_branch_3)  # -> Out, A

# ---- group: Pozitionierung / Positionierung
curve = Curve(<curve referenced from the Rhino model>)

# ----
pie_chart = PieChart(panel_9)

# ---- group: Pozitionierung
curve_2 = Curve(curve)

# ----
panel_10 = Panel(panel_7)
point = Point(<point referenced from the Rhino model>)
point_2 = Point(<point referenced from the Rhino model>)
point_3 = Point(<point referenced from the Rhino model>)
incentre = Incentre(PointA=point, PointB=point_2, PointC=point_3)  # -> Incentre, BisectorA, BisectorB, BisectorC
line = Line(StartPoint=point, EndPoint=point_2)
line_2 = Line(StartPoint=point, EndPoint=point_3)
line_3 = Line(StartPoint=point_2, EndPoint=point_3)
line_4 = Line(incentre.BisectorC)
line_5 = Line(incentre.BisectorA)
line_6 = Line(incentre.BisectorB)
panel_11 = Panel(panel_9)
point_4 = Point(incentre.Incentre)
divide_curve = DivideCurve(Curve=line_3, Count=Slider(2, range=0..10), Kinks=False)  # -> Points, Tangents, Parameters
square_root = SquareRoot(Value=panel_10)
average = Average(Input=square_root)
number = Number(average)
addition = Addition(A=average, B=number)
list_length = ListLength(List=panel_10)
multiplication = Multiplication(A=panel_11, B=Slider(5, range=0..10))
number_2 = Number(list_length)
addition_2 = Addition(A=number_2, B=Slider(-1, range=-1..2))
divide_curve_2 = DivideCurve(Curve=curve_2, Count=addition_2, Kinks=False)  # -> Points, Tangents, Parameters
rectangle = Rectangle(Plane=divide_curve_2.Points, XSize=square_root, YSize=square_root, Radius=0)  # -> Rectangle, Length
unit_z = UnitZ(Factor=multiplication)
area = Area(Geometry=rectangle.Rectangle)  # -> Area, Centroid
point_5 = Point(area.Centroid)
boundary_surfaces = BoundarySurfaces(Edges=rectangle.Rectangle)
point_6 = Point(divide_curve_2.Points)
unit_z_2 = UnitZ(Factor="0.5")
extrude = Extrude(Base=boundary_surfaces, Direction=unit_z_2)
deconstruct = Deconstruct(Point=point_6)  # -> XComponent, YComponent, ZComponent

# ---- group: Get down the text
deconstruct_2 = Deconstruct(Point=point_6)  # -> XComponent, YComponent, ZComponent
subtraction = Subtraction(A=deconstruct_2.YComponent, B=Slider(6, range=0..10))
construct_point = ConstructPoint(XCoordinate=deconstruct_2.XComponent, YCoordinate=subtraction, ZCoordinate=deconstruct_2.ZComponent)

# ----
move = Move(Geometry=extrude, Motion=unit_z)  # -> Geometry, Transform
subtraction_2 = Subtraction(A=deconstruct.YComponent, B=Slider(3, range=0..10))
colour_swatch = ColourSwatch(SwatchColor=RGB(255, 255, 255))
construct_point_2 = ConstructPoint(XCoordinate=deconstruct.XComponent, YCoordinate=subtraction_2, ZCoordinate=deconstruct.ZComponent)
panel_12 = Panel(tree_branch)
number_slider = Slider(18, range=0..100)
concatenate = Concatenate(Fragment_A=panel_10, Fragment_B=" m²")
number_slider_2 = Slider(0.7, range=0..10)
colour_swatch_2 = ColourSwatch(SwatchColor=RGB(0, 0, 0))
geometry = Geometry(boundary_surfaces)
list_item = ListItem(List=geometry, Index=Slider(4, range=0..8), Wrap=True)
list_length_2 = ListLength(List=geometry)
subtraction_3 = Subtraction(A=list_length_2, B=1)
list_item_2 = ListItem(List=geometry, Index=subtraction_3, Wrap=True)
text_tag_3d = TextTag3D(Location=construct_point_2, Text=concatenate, Size=number_slider_2, Colour=colour_swatch_2, Justification=7)
text_tag_3d_2 = TextTag3D(Location=construct_point, Text=panel_12, Size=number_slider_2, Colour=colour_swatch_2, Justification=7)
custom_preview = CustomPreview(Geometry=geometry, Material=ColourSwatch(SwatchColor=RGB(255, 0, 0)))
